% Requirement links of FrequencyDomainAnalysisTest.m (R2023b)

% line 1 verifies TimeFreqAnalysis.slreqx#3
classdef FrequencyDomainAnalysisTest < matlab.unittest.TestCase

% line 29 verifies TimeFreqAnalysis.slreqx#10
            testCase.verifyLessThanOrEqual(peakFrequency,1000);

% line 42 verifies TimeFreqAnalysis.slreqx#11
            testCase.verifyEqual(cell2mat(signal),y_reconstructed,'AbsTol',1e2)

% line 51 verifies TimeFreqAnalysis.slreqx#13
            testCase.verifyGreaterThan(freqAnalysisResults.pitchCalculated,0);

% lines 62-63 verifies TimeFreqAnalysis.slreqx#12
            testCase.verifyGreaterThan(freqAnalysisResults.fundamentalFrequency, lower_f0);
            testCase.verifyLessThanOrEqual(freqAnalysisResults.fundamentalFrequency, upper_f0);