% Requirement links of TimeDomainAnalysisTest.m (R2023b)

% line 1 verifies TimeFreqAnalysis.slreqx#2
classdef TimeDomainAnalysisTest < matlab.unittest.TestCase

% line 26 verifies TimeFreqAnalysis.slreqx#4
            testCase.verifyLessThanOrEqual(analysisResults.peakAmplitude,expectedAmplitude);

% line 33 verifies TimeFreqAnalysis.slreqx#8
            testCase.verifyGreaterThanOrEqual(analysisResults.zeroCrossingRate,0);

% line 50 verifies TimeFreqAnalysis.slreqx#6
            testCase.verifyGreaterThanOrEqual(analysisResult.rmsAmplitude, LowerLimit);

% line 58 verifies TimeFreqAnalysis.slreqx#7
            testCase.verifyLessThanOrEqual(analysisResult.rmsDBFS,UpperLimit);