# Requirement set TimeFreqAnalysis (R2023b)
Requirements to test in time and frequency domain analysis

## 1 [#2] Time Domain Analysis

### 1.1 [#4] Peak Amplitude

### 1.2 [#6] RMS Amplitude

### 1.3 [#7] RMS DBFS

### 1.4 [#8] ZCR

## 2 [#3] Frequency Domain Analysis

### 2.1 [#10] Test Peak Frequency
Peak frequency must be less than the Nyquist frequency which is half of the sampling frequency.

### 2.2 [#12] Pitch of audio

### 2.3 [#13] Fundamental freq range

### 2.4 [#14] FFT of signal

## 3 [#11] Classification test