% Requirement links of analyzeFrequencyDomain.m (R2023b)

% line 2 implements TimeFreqAnalysis.slreqx#3
function freqAnalysisResults = analyzeFrequencyDomain(audioSignal, fs)

% line 19 implements TimeFreqAnalysis.slreqx#11
    % Compute the one-sided FFT

% line 22 implements TimeFreqAnalysis.slreqx#10
        N = length(Y);

% line 23 implements TimeFreqAnalysis.slreqx#13
        Y_one_sided = Y(1:N/2+1);

% line 25 implements TimeFreqAnalysis.slreqx#12
        pitchCalculated = pitch(audioSignal',fs);