% Requirement links of analyzeTimeDomain.m (R2023b)

% line 2 implements TimeFreqAnalysis.slreqx#2
function analysisResults = analyzeTimeDomain(audioSignal, fs)

% line 35 implements TimeFreqAnalysis.slreqx#4
       peakAmplitude = max(abs(audioSignal));

% line 36 implements TimeFreqAnalysis.slreqx#6
       rmsAmplitude = sqrt(mean(audioSignal).^2);

% line 38 implements TimeFreqAnalysis.slreqx#7
       rmsDBFS = 20 * log10(rmsAmplitude/peakAmplitude);

% line 39 implements TimeFreqAnalysis.slreqx#8
       zeroCrossingRate = sum(abs(diff(audioSignal > 0))) / length(audioSignal);